# Grasshopper definition Creative_Coding_Wickerson_Studios_002.gh (Grasshopper 1.0.7)
# plug-ins: Bifocals, Pufferfish

number_slider = Slider(5, range=1..11)
square = Square(Plane=PlaneXY(0, 0, 0), Size=Slider(10, range=0..10), ExtentX=number_slider, ExtentY=number_slider)  # -> Cells, simplify(Points)
panel = Panel("{(0,2,...);0}[(0,2,...)]")
cull_duplicates = CullDuplicates(Points=square.Points, Tolerance=0.1, CullMode=3)  # -> Points, Indices, Valence
boundary_surfaces = BoundarySurfaces(Edges=square.Cells)
split_tree = SplitTree(Data=cull_duplicates.Points, Masks=flatten("{(0,2,...);0}[(1,3,...)]"))  # -> Positive, Negative
area = Area(Geometry=boundary_surfaces)  # -> Area, Centroid
panel_2 = Panel(cull_duplicates.Points)
unit_z = UnitZ(Factor=Slider(10, range=0..10))
clean_tree = CleanTree(RemoveNulls=True, RemoveInvalid=True, RemoveEmpty=False, Tree=split_tree.Positive)
clean_tree_2 = CleanTree(RemoveNulls=True, RemoveInvalid=True, RemoveEmpty=False, Tree=split_tree.Negative)
panel_3 = Panel(split_tree.Positive)
negative = Negative(Value=unit_z)
move = Move(Geometry=clean_tree, Motion=unit_z)  # -> Geometry, Transform
move_2 = Move(Geometry=clean_tree_2, Motion=negative)  # -> Geometry, Transform
cross_reference = CrossReference(ListListA=move.Geometry, ListListB=move_2.Geometry, CrossMode=2)  # -> ListListA, ListListB
pi = Pi(Factor=Slider(0.56, range=0..2))
rotate_3d = Rotate3D(Geometry=cull_duplicates.Points, Angle=pi, Center=area.Centroid, Axis=Vector(0, 0, 1))  # -> Geometry, Transform
merge = Merge(Data1=cross_reference.ListListA, Data2=rotate_3d.Geometry, Data3=cross_reference.ListListB)  # -> flatten(Result)
nurbs_curve = NurbsCurve(Vertices=merge, Degree=3, Periodic=False)  # -> Curve, Length, Domain
polar_array = PolarArray(Geometry=nurbs_curve.Curve, Plane=PlaneXY(0, 0, 0), Count="4", Angle=6.283185307)  # -> Geometry, Transform
gene_pool = GenePool(Decimals=2, Maximum=1, Minimum=0, Value=[0, 0.22, 0.41, 0.45, 0.5, 0.6, 0.64, 0.7, 0.88, 1])
gene_pool_2 = GenePool(
    Decimals=3,
    Maximum=1,
    Minimum=0.05,
    Value=[0.3307851034, 0.1378611468, 0.1851039285, 0.05389471911, 0.4495170748, 0.8297296575, 0.1048277018, 0.8528491818, 0.7675153621, 0.3528327483])
gene_pool_3 = GenePool(Decimals=2, Maximum=300, Minimum=100, Value=[201.2787327, 263.177167, 108.0560315, 245.3029023])
point_on_curve = PointOnCurve(polar_array.Geometry, parameter=0.788)
metaball_t_custom = MetaBallTCustom(Points=point_on_curve, Charge=gene_pool_3, Plane=PlaneXY(0, 0, 0), Threshold=0.5)
rebuild_curve = RebuildCurve(Curve=metaball_t_custom, Count=Slider(28, range=0..100), Degree="3", EndTangents=False)
pipe_variable = PipeVariable(Curve=reparameterize(polar_array.Geometry), Parameters=gene_pool, Radii=gene_pool_2, Caps=0)
pipe = Pipe(Curve=rebuild_curve, Radius=1, Caps=0)
custom_preview = CustomPreview(
    Geometry=pipe_variable,
    Material=graft([ColourSwatch(SwatchColor=RGB(199, 14, 255)), ColourSwatch(SwatchColor=RGB(33, 143, 255)), ColourSwatch(SwatchColor=RGB(57, 186, 50)), ColourSwatch(SwatchColor=RGB(189, 54, 50))]))
custom_preview_2 = CustomPreview(Geometry=pipe, Material=ColourSwatch(SwatchColor=RGB(5, 214, 255)))
