# Grasshopper definition Creative_Coding_Wickerson_Studios_003.gh (Grasshopper 1.0.7)
# plug-ins: Bifocals

number_slider = Slider(15, range=1..15)
radial = Radial(Plane=PlaneXY(0, 0, 0), Size=Slider(1.927, range=1..5), ExtentR=number_slider, ExtentP=number_slider)  # -> Cells, Points
list_length = ListLength(List=radial.Cells)
range = Range(Domain=Slider(20, range=0..20), Steps=expr("x-1", list_length))
vector_xyz = VectorXYZ(XComponent=0, YComponent=0, ZComponent=range)  # -> Vector, Length
move = Move(Geometry=radial.Cells, Motion=vector_xyz.Vector)  # -> Geometry, Transform
panel = Panel("{0;0;(0,2,...);0}[(0,2,...)]")
split_tree = SplitTree(Data=move.Geometry, Masks=flatten("{*;*;*;*}[(0,2,...)]"))  # -> Positive, Negative
geometry = Geometry(split_tree.Positive)
split_tree_2 = SplitTree(Data=geometry, Masks=flatten(panel))  # -> Positive, Negative
split_tree_3 = SplitTree(Data=geometry, Masks=flatten(panel))  # -> Positive, Negative
geometry_2 = Geometry(split_tree_3.Positive)
geometry_3 = Geometry(split_tree_2.Negative)
pi = Pi(Factor=Slider(2, range=0..2))
vector_xyz_2 = VectorXYZ(XComponent=Slider(0, range=0..1), YComponent=Slider(1, range=0..1), ZComponent=Slider(1, range=0..1))  # -> Vector, Length
construct_point = ConstructPoint(XCoordinate=0, YCoordinate=0, ZCoordinate=0)
negative = Negative(Value=vector_xyz_2.Vector)
area = Area(Geometry=geometry_2)  # -> Area, Centroid
line_sdl = LineSDL(Start=construct_point, Direction=vector_xyz_2.Vector, Length=1)
area_2 = Area(Geometry=geometry_3)  # -> Area, Centroid
line_sdl_2 = LineSDL(Start=construct_point, Direction=negative, Length=1)
rotate_3d = Rotate3D(Geometry=geometry_2, Angle=pi, Center=area.Centroid, Axis=line_sdl)  # -> Geometry, Transform
rotate_3d_2 = Rotate3D(Geometry=geometry_3, Angle=pi, Center=area_2.Centroid, Axis=line_sdl_2)  # -> Geometry, Transform
merge = Merge(Data1=rotate_3d.Geometry, Data2=rotate_3d_2.Geometry)
polar_array = PolarArray(Geometry=merge, Plane=PlaneXY(0, 0, 0), Count=Slider(3, range=0..10), Angle=6.283185307)  # -> Geometry, Transform
