# Grasshopper definition Creative_Coding_Wickerson_Studios_003d.gh (Grasshopper 1.0.7)
# plug-ins: Bifocals

number_slider = Slider(15, range=1..15)

number_slider_2 = Slider(20, range=0..20)  # disabled
number_slider_3 = Slider(1.655, range=1..5)  # disabled
number_slider_4 = Slider(2, range=0..2)  # disabled
number_slider_5 = Slider(15, range=1..15)  # disabled
radial = Radial(Plane=PlaneXY(0, 0, 0), Size=number_slider_3, ExtentR=number_slider_5, ExtentP=number_slider_5)  # -> Cells, Points; disabled
list_length = ListLength(List=radial.Cells)  # disabled
range = Range(Domain=number_slider_2, Steps=expr("x-1", list_length))  # disabled
vector_xyz = VectorXYZ(XComponent=0, YComponent=0, ZComponent=range)  # -> Vector, Length; disabled
panel = Panel("{*;*;*;*}[(0,2,...)]")  # disabled
move = Move(Geometry=radial.Cells, Motion=vector_xyz.Vector)  # -> Geometry, Transform; disabled
panel_2 = Panel("{0;0;(0,2,...);0}[(0,2,...)]")  # disabled
split_tree = SplitTree(Data=move.Geometry, Masks=flatten(panel))  # -> Positive, Negative; disabled
geometry = Geometry(split_tree.Positive)  # disabled
split_tree_2 = SplitTree(Data=geometry, Masks=flatten(panel_2))  # -> Positive, Negative; disabled
split_tree_3 = SplitTree(Data=geometry, Masks=flatten(panel_2))  # -> Positive, Negative; disabled
number_slider_6 = Slider(1, range=0..1)  # disabled
number_slider_7 = Slider(1, range=0..1)  # disabled
number_slider_8 = Slider(0, range=0..1)  # disabled
geometry_2 = Geometry(split_tree_3.Positive)  # disabled
geometry_3 = Geometry(split_tree_2.Negative)  # disabled
pi = Pi(Factor=number_slider_4)  # disabled
vector_xyz_2 = VectorXYZ(XComponent=number_slider_8, YComponent=number_slider_7, ZComponent=number_slider_6)  # -> Vector, Length; disabled
construct_point = ConstructPoint(XCoordinate=0, YCoordinate=0, ZCoordinate=0)  # disabled
negative = Negative(Value=vector_xyz_2.Vector)  # disabled
area = Area(Geometry=geometry_2)  # -> Area, Centroid; disabled
line_sdl = LineSDL(Start=construct_point, Direction=vector_xyz_2.Vector, Length=1)  # disabled
area_2 = Area(Geometry=geometry_3)  # -> Area, Centroid; disabled
line_sdl_2 = LineSDL(Start=construct_point, Direction=negative, Length=1)  # disabled
rotate_3d = Rotate3D(Geometry=geometry_3, Angle=pi, Center=area_2.Centroid, Axis=line_sdl_2)  # -> Geometry, Transform; disabled
rotate_3d_2 = Rotate3D(Geometry=geometry_2, Angle=pi, Center=area.Centroid, Axis=line_sdl)  # -> Geometry, Transform; disabled
number_slider_9 = Slider(1, range=0..10)  # disabled
merge = Merge(Data1=rotate_3d_2.Geometry, Data2=rotate_3d.Geometry)  # disabled
polar_array = PolarArray(Geometry=merge, Plane=PlaneXY(0, 0, 0), Count=number_slider_9, Angle=6.283185307)  # -> Geometry, Transform; disabled
deconstruct_brep = DeconstructBrep(Brep=rotate_3d_2.Geometry)  # -> flatten(Faces), Edges, Vertices; disabled
deconstruct_brep_2 = DeconstructBrep(Brep=rotate_3d_2.Geometry)  # -> Faces, Edges, Vertices; disabled
deconstruct_brep_3 = DeconstructBrep(Brep=rotate_3d.Geometry)  # -> Faces, Edges, Vertices; disabled
deconstruct_brep_4 = DeconstructBrep(Brep=rotate_3d.Geometry)  # -> flatten(Faces), Edges, Vertices; disabled
loft = Loft(
    Curves=[deconstruct_brep.Faces, deconstruct_brep_3.Faces],
    Options={Adjust=False, Closed=True, LoftEnds=0, LoftSimp=0, LoftType=0, Rebuild=10, Refit=0.01})  # disabled
loft_2 = Loft(
    Curves=[deconstruct_brep_2.Faces, deconstruct_brep_4.Faces],
    Options={Adjust=False, Closed=True, LoftEnds=0, LoftSimp=0, LoftType=0, Rebuild=10, Refit=0.01})  # disabled
colour_swatch = ColourSwatch(SwatchColor=RGB(255, 255, 255))  # disabled
colour_swatch_2 = ColourSwatch(SwatchColor=RGB(149, 255, 255))  # disabled
custom_preview = CustomPreview(Geometry=loft_2, Material=colour_swatch)  # disabled
custom_preview_2 = CustomPreview(Geometry=loft, Material=colour_swatch_2)  # disabled

radial_2 = Radial(Plane=PlaneXY(0, 0, 0), Size=Slider(1.655, range=1..5), ExtentR=number_slider, ExtentP=number_slider)  # -> Cells, Points
list_length_2 = ListLength(List=radial_2.Cells)
range_2 = Range(Domain=Slider(20, range=0..20), Steps=expr("x-1", list_length_2))
vector_xyz_3 = VectorXYZ(XComponent=0, YComponent=0, ZComponent=range_2)  # -> Vector, Length
move_2 = Move(Geometry=radial_2.Cells, Motion=vector_xyz_3.Vector)  # -> Geometry, Transform
panel_3 = Panel("{0;0;(0,2,...);0}[(0,2,...)]")
split_tree_4 = SplitTree(Data=move_2.Geometry, Masks=flatten("{*;*;*;*}[(0,2,...)]"))  # -> Positive, Negative
geometry_4 = Geometry(split_tree_4.Positive)
split_tree_5 = SplitTree(Data=geometry_4, Masks=flatten(panel_3))  # -> Positive, Negative
split_tree_6 = SplitTree(Data=geometry_4, Masks=flatten(panel_3))  # -> Positive, Negative
geometry_5 = Geometry(split_tree_6.Positive)
geometry_6 = Geometry(split_tree_5.Negative)
pi_2 = Pi(Factor=Slider(2, range=0..2))
vector_xyz_4 = VectorXYZ(XComponent=Slider(0, range=0..1), YComponent=Slider(1, range=0..1), ZComponent=Slider(1, range=0..1))  # -> Vector, Length
construct_point_2 = ConstructPoint(XCoordinate=0, YCoordinate=0, ZCoordinate=0)
negative_2 = Negative(Value=vector_xyz_4.Vector)
area_3 = Area(Geometry=geometry_5)  # -> Area, Centroid
line_sdl_3 = LineSDL(Start=construct_point_2, Direction=vector_xyz_4.Vector, Length=1)
area_4 = Area(Geometry=geometry_6)  # -> Area, Centroid
line_sdl_4 = LineSDL(Start=construct_point_2, Direction=negative_2, Length=1)
rotate_3d_3 = Rotate3D(Geometry=geometry_6, Angle=pi_2, Center=area_4.Centroid, Axis=line_sdl_4)  # -> Geometry, Transform
rotate_3d_4 = Rotate3D(Geometry=geometry_5, Angle=pi_2, Center=area_3.Centroid, Axis=line_sdl_3)  # -> Geometry, Transform
merge_2 = Merge(Data1=rotate_3d_4.Geometry, Data2=rotate_3d_3.Geometry)
polar_array_2 = PolarArray(Geometry=merge_2, Plane=PlaneXY(0, 0, 0), Count=Slider(1, range=0..10), Angle=6.283185307)  # -> Geometry, Transform
deconstruct_brep_5 = DeconstructBrep(Brep=rotate_3d_4.Geometry)  # -> flatten(Faces), Edges, Vertices
deconstruct_brep_6 = DeconstructBrep(Brep=rotate_3d_4.Geometry)  # -> Faces, Edges, Vertices
deconstruct_brep_7 = DeconstructBrep(Brep=rotate_3d_3.Geometry)  # -> Faces, Edges, Vertices
deconstruct_brep_8 = DeconstructBrep(Brep=rotate_3d_3.Geometry)  # -> flatten(Faces), Edges, Vertices
loft_3 = Loft(
    Curves=[deconstruct_brep_5.Faces, deconstruct_brep_7.Faces],
    Options={Adjust=False, Closed=True, LoftEnds=0, LoftSimp=0, LoftType=0, Rebuild=10, Refit=0.01})
loft_4 = Loft(
    Curves=[deconstruct_brep_6.Faces, deconstruct_brep_8.Faces],
    Options={Adjust=False, Closed=True, LoftEnds=0, LoftSimp=0, LoftType=0, Rebuild=10, Refit=0.01})
custom_preview_3 = CustomPreview(Geometry=loft_4, Material=ColourSwatch(SwatchColor=RGB(255, 255, 255)))
custom_preview_4 = CustomPreview(Geometry=loft_3, Material=ColourSwatch(SwatchColor=RGB(149, 255, 255)))
