# Grasshopper definition Creative_Coding_Wickerson_Studios_003f.gh (Grasshopper 1.0.7)
# plug-ins: Bifocals

number_slider = Slider(8, range=0..10)
square = Square(Plane=PlaneXY(0, 0, 0), Size=Slider(8, range=0..100), ExtentX=number_slider, ExtentY=number_slider)  # -> Cells, Points
param_viewer = ParamViewer(square.Cells)
param_viewer_2 = ParamViewer(square.Points)
split_tree = SplitTree(Data=square.Cells, Masks=flatten("{*;*;(0,2,...)}[(1,4,...)]"))  # -> Positive, Negative
geometry = Geometry(split_tree.Negative)
geometry_2 = Geometry(split_tree.Positive)
param_viewer_3 = ParamViewer(geometry_2)
param_viewer_4 = ParamViewer(geometry)
clean_tree = CleanTree(RemoveNulls=True, RemoveInvalid=True, RemoveEmpty="1", Tree=geometry_2)
list_length = ListLength(List=flatten(clean_tree))
list_length_2 = ListLength(List=flatten(clean_tree))
expression = Expression(x=list_length, Expression="x-1")
expression_2 = Expression(x=list_length_2, Expression="x-1")
trigger = Trigger(Interval=200, TimerInterval=200, Target=data_recorder)
range = Range(Domain=Slider(26, range=0..100), Steps=expression)
range_2 = Range(Domain=Slider(59, range=0..100), Steps=expression_2)
data_recorder = DataRecorder("100", DataLimit=-10, RecordData=True)  # disabled
unit_z = UnitZ(Factor=range)
unit_z_2 = UnitZ(Factor=range_2)
list_length_3 = ListLength(List=data_recorder)
jitter = Jitter(List=unit_z, Jitter=Slider(0.79, range=0..1), Seed=Slider(46, range=0..100))  # -> Values, Indices
jitter_2 = Jitter(List=unit_z_2, Jitter=Slider(0.14, range=0..1), Seed=Slider(0, range=0..100))  # -> Values, Indices
sine = Sine(Value=list_length_3)
move = Move(Geometry=flatten(clean_tree), Motion=jitter.Values)  # -> Geometry, Transform
move_2 = Move(Geometry=flatten(clean_tree), Motion=jitter_2.Values)  # -> Geometry, Transform
geometry_3 = Geometry(graft(clean_tree))
geometry_4 = Geometry(graft(clean_tree))
multiplication = Multiplication(A=sine, B="2")
clean_tree_2 = CleanTree(RemoveNulls=True, RemoveInvalid=True, RemoveEmpty="1", Tree=geometry_3)  # -> graft(Tree)
clean_tree_3 = CleanTree(RemoveNulls=True, RemoveInvalid=True, RemoveEmpty="1", Tree=geometry_4)  # -> graft(Tree)
panel = Panel(multiplication)
geometry_5 = Geometry(graft(move.Geometry))
geometry_6 = Geometry(graft(move_2.Geometry))
match_tree = MatchTree(Tree=clean_tree_3, Guide=geometry_6)
addition = Addition(A=multiplication, B=Slider(0.22, range=0..1))
match_tree_2 = MatchTree(Tree=clean_tree_2, Guide=geometry_5)
negative = Negative(Value=addition)
construct_point = ConstructPoint(XCoordinate=0, YCoordinate=0, ZCoordinate=multiplication)
area = Area(Geometry=match_tree_2)  # -> Area, Centroid
area_2 = Area(Geometry=match_tree)  # -> Area, Centroid
pi = Pi(Factor=multiplication)
pi_2 = Pi(Factor=negative)
rotate_3d = Rotate3D(Geometry=geometry_5, Angle=pi, Center=area.Centroid, Axis=Vector(0, 0, 1))  # -> Geometry, Transform
rotate_3d_2 = Rotate3D(Geometry=geometry_6, Angle=pi_2, Center=area_2.Centroid, Axis=Vector(0, 0, 1))  # -> Geometry, Transform
area_3 = Area(Geometry=rotate_3d_2.Geometry)  # -> Area, Centroid
deconstruct = Deconstruct(Point=area_3.Centroid)  # -> XComponent, YComponent, ZComponent
merge = Merge(Data1=match_tree_2, Data2=rotate_3d.Geometry, Data3=rotate_3d_2.Geometry)
bounds = Bounds(Numbers=flatten(deconstruct.ZComponent))
construct_domain = ConstructDomain(DomainStart=0, DomainEnd=1)
panel_2 = Panel(construct_domain)
remap_numbers = RemapNumbers(Value=deconstruct.ZComponent, Source=bounds, Target=construct_domain)  # -> Mapped, Clipped
loft = Loft(Curves=merge, Options={Adjust=False, Closed=False, LoftEnds=0, LoftSimp=0, LoftType=0, Rebuild=10, Refit=0.01})  # disabled
panel_3 = Panel(remap_numbers.Mapped)
gradient = Gradient(
    LowerLimit=0,
    UpperLimit=1,
    Parameter=remap_numbers.Mapped,
    stops=[0: RGB(234, 38, 0), 0.25: RGB(234, 126, 0), 0.5: RGB(254, 244, 84), 0.75: RGB(173, 203, 249), 1: RGB(75, 107, 169)])
geometry_7 = Geometry(rotate_3d_2.Geometry)  # disabled
boundary_surfaces = BoundarySurfaces(Edges=geometry_7)  # disabled
custom_preview = CustomPreview(Geometry=merge, Material=gradient)
