# Grasshopper definition Creative_Coding_Wickerson_Studios_003g.gh (Grasshopper 1.0.7)
# plug-ins: Bifocals

number_slider = Slider(10, range=0..100)
square = Square(Plane=PlaneXY(0, 0, 0), Size=Slider(48, range=0..100), ExtentX=number_slider, ExtentY=number_slider)  # -> Cells, Points

# ----
# Mask
param_viewer = ParamViewer(square.Cells)
param_viewer_2 = ParamViewer(square.Points)

split_tree = SplitTree(Data=square.Cells, Masks=flatten("{*;*;(0,2,...)}[(1,4,...)]"))  # -> Positive, Negative
geometry = Geometry(split_tree.Negative)
geometry_2 = Geometry(split_tree.Positive)

# ----
# Oscillation
trigger = Trigger(Interval=50, TimerInterval=50, Target=data_recorder)  # disabled
data_recorder = DataRecorder("1", DataLimit=-10, RecordData=True)  # disabled
number_slider_2 = Slider(2.204, range=0..3)
list_length = ListLength(List=data_recorder)
sine = Sine(Value=list_length)
multiplication = Multiplication(A=sine, B=number_slider_2)
division = Division(A=sine, B=number_slider_2)
panel = Panel(sine)
construct_point = ConstructPoint(XCoordinate=0, YCoordinate=0, ZCoordinate=division)

# ----
# Geometry/Transformations
param_viewer_3 = ParamViewer(geometry_2)
param_viewer_4 = ParamViewer(geometry)
clean_tree = CleanTree(RemoveNulls=True, RemoveInvalid=True, RemoveEmpty="1", Tree=geometry_2)
list_length_2 = ListLength(List=flatten(clean_tree))
expression = Expression(x=list_length_2, Expression="x-1")
range = Range(Domain=Slider(59, range=0..100), Steps=expression)
range_2 = Range(Domain=Slider(26, range=0..100), Steps=expression)
number_slider_3 = Slider(14, range=0..100)
unit_z = UnitZ(Factor=range_2)
unit_z_2 = UnitZ(Factor=range)
jitter = Jitter(List=unit_z_2, Jitter=Slider(0.27, range=0..1), Seed=number_slider_3)  # -> Values, Indices
jitter_2 = Jitter(List=unit_z, Jitter=Slider(0.73, range=0..1), Seed=number_slider_3)  # -> Values, Indices
move = Move(Geometry=flatten(clean_tree), Motion=jitter_2.Values)  # -> Geometry, Transform
move_2 = Move(Geometry=flatten(clean_tree), Motion=jitter.Values)  # -> Geometry, Transform
geometry_3 = Geometry(graft(clean_tree))
geometry_4 = Geometry(graft(clean_tree))
clean_tree_2 = CleanTree(RemoveNulls=True, RemoveInvalid=True, RemoveEmpty="1", Tree=geometry_3)  # -> graft(Tree)
clean_tree_3 = CleanTree(RemoveNulls=True, RemoveInvalid=True, RemoveEmpty="1", Tree=geometry_4)  # -> graft(Tree)
geometry_5 = Geometry(graft(move_2.Geometry))
geometry_6 = Geometry(graft(move.Geometry))
match_tree = MatchTree(Tree=clean_tree_2, Guide=geometry_6)
addition = Addition(A=division, B=Slider(0.5, range=0..1))
match_tree_2 = MatchTree(Tree=clean_tree_3, Guide=geometry_5)
negative = Negative(Value=addition)
area = Area(Geometry=match_tree_2)  # -> Area, Centroid
area_2 = Area(Geometry=match_tree)  # -> Area, Centroid
pi = Pi(Factor=negative)
pi_2 = Pi(Factor=division)
rotate_3d = Rotate3D(Geometry=geometry_6, Angle=pi_2, Center=area_2.Centroid, Axis=Vector(0, 0, 1))  # -> Geometry, Transform
rotate_3d_2 = Rotate3D(Geometry=geometry_5, Angle=pi, Center=area.Centroid, Axis=Vector(0, 0, 1))  # -> Geometry, Transform
area_3 = Area(Geometry=rotate_3d_2.Geometry)  # -> Area, Centroid
deconstruct = Deconstruct(Point=area_3.Centroid)  # -> XComponent, YComponent, ZComponent

# ----
# Remap
construct_domain = ConstructDomain(DomainStart=0, DomainEnd=1)
bounds = Bounds(Numbers=flatten(deconstruct.ZComponent))
panel_2 = Panel(construct_domain)
remap_numbers = RemapNumbers(Value=deconstruct.ZComponent, Source=bounds, Target=construct_domain)  # -> Mapped, Clipped
panel_3 = Panel(remap_numbers.Mapped)

# ----
# Display Render
merge = Merge(Data1=match_tree, Data2=rotate_3d_2.Geometry, Data3=rotate_3d.Geometry)
gradient = Gradient(
    LowerLimit=0,
    UpperLimit=1,
    Parameter=remap_numbers.Mapped,
    stops=[0: RGB(234, 38, 0), 0.25: RGB(234, 126, 0), 0.5: RGB(254, 244, 84), 0.75: RGB(173, 203, 249), 1: RGB(75, 107, 169)])
geometry_7 = Geometry(merge)
boundary_surfaces = BoundarySurfaces(Edges=geometry_7)
loft = Loft(Curves=merge, Options={Adjust=False, Closed=False, LoftEnds=0, LoftSimp=0, LoftType=0, Rebuild=10, Refit=0.01})
custom_preview = CustomPreview(Geometry=[loft, boundary_surfaces], Material=gradient)
