# Grasshopper definition Creative_Coding_Wickerson_Studios_004.gh (Grasshopper 1.0.7)
# plug-ins: Bifocals

number_slider = Slider(10, range=0..10)
createsinewaveexponential = CreateSineWaveExponential(num=Slider(10, range=0..10), unit=Slider(2.17, range=0..10))  # -> out, OutCurves, OutSurface, OutLoft; inputs num: Int32, unit: Double
# ---------- createsinewaveexponential: C# ----------
    //list of all points
    List<Point3d> allPoints = new List<Point3d>();
    //list of curves
    List<Curve> curves = new List<Curve>();

    for(int y = 0; y < num; y++)
    {
      //curve points
      List<Point3d> crvPoints = new List<Point3d>();
      for(int x = 0; x < num; x++)
      {
        double z = Math.Sin(Math.PI / unit * (x * y));
        Point3d pt = new Point3d(x, y, z);
        crvPoints.Add(pt);
        allPoints.Add(pt);
      }
      //create a degree 3 curve from control points
      Curve crv = Curve.CreateControlPointCurve(crvPoints, 3);
      curves.Add(crv);
    }
    //create a nurbs surface from control points
    NurbsSurface srf = NurbsSurface.CreateFromPoints(allPoints, num, num, 3, 3);

    //create a loft brep from curves
    Brep[ ] breps = Brep.CreateFromLoft(curves, Point3d.Unset, Point3d.Unset, LoftType.Tight, false);

    //Assign output
    OutCurves = curves;
    OutSurface = srf;
    OutLoft = breps;
# ---------- end createsinewaveexponential ----------
gameoflife = GameOfLife(srf=createsinewaveexponential.OutSurface, uNum=number_slider, vNum=number_slider, seed=Slider(47, range=0..100))  # -> out, PointGrid, StateGrid; inputs srf: Surface, uNum: Int32, vNum: Int32, seed: Int32
# ---------- gameoflife: C# ----------
    if(uNum < 2)
      uNum = 2;
    if(vNum < 2)
      vNum = 2;

    double uStep = srf.Domain(0).Length / uNum;
    double vStep = srf.Domain(1).Length / vNum;
    double uMin = srf.Domain(0).Min;
    double vMin = srf.Domain(1).Min;

    //create a grid of points and a grid of states
    DataTree<Point3d> pointsTree = new DataTree<Point3d>();
    DataTree<int> statesTree = new DataTree<int>();
    int pathIndex = 0;
    Random rand = new Random(seed);
    for (int i = 0; i <= uNum; i++)
    {
      List<Point3d> ptList = new List<Point3d>();
      List<int> stateList = new List<int>();
      GH_Path path = new GH_Path(pathIndex);
      pathIndex = pathIndex + 1;
      for (int j = 0; j <= vNum; j++)
      {
        Point3d srfPt = srf.PointAt(uMin + i * uStep, vMin + j * vStep);
        ptList.Add(srfPt);
        int randState = rand.Next(0, 2);
        stateList.Add(randState);
      }
      pointsTree.AddRange(ptList, path);
      statesTree.AddRange(stateList, path);
    }

    PointGrid = pointsTree;
    StateGrid = statesTree;
# ---------- end gameoflife ----------
panel = Panel(gameoflife.StateGrid)
point = Point(gameoflife.PointGrid)
cull_pattern = CullPattern(List=point, CullPattern=gameoflife.StateGrid)
