# Grasshopper definition Creative_Coding_Wickerson_Studios_005.gh (Grasshopper 1.0.7)
# plug-ins: Bifocals

number_slider = Slider(2, range=0..10)
number_slider_2 = Slider(2, range=0..10)
series = Series(Start=0, Step=1, Count=10)
a_04_formatlistandoutput = A_04_FormatListAndOutput(areasAsNumbers=series)  # -> out, formattedText; inputs areasAsNumbers: list of Double
# ---------- a_04_formatlistandoutput: C# ----------
    List<string> areasAsText = new List<string>();
    for(int i = 0; i < areasAsNumbers.Count; i++){
      areasAsText.Add(string.Format("area[{0}]: {1:0.00}m²", i, areasAsNumbers[i]) );
      // "{0}" is swapped with the first argument after text string -> i
      // "{1}" is swapped with the second argument after text string -> areasAsNumbers[i] (i-th element of areas list)
    }
    
    formattedText = areasAsText; //outputting whole list
# ---------- end a_04_formatlistandoutput ----------
a_01_helloworld = A_01_HelloWorld()  # -> out, A
# ---------- a_01_helloworld: C# usings ----------
using System.IO;
using System.Linq;
using System.Data;
using System.Drawing;
using System.Reflection;
using System.Windows.Forms;
using System.Xml;
using System.Xml.Linq;
using System.Runtime.InteropServices;

using Rhino.DocObjects;
using Rhino.Collections;
using GH_IO;
using GH_IO.Serialization;
# ---------- a_01_helloworld: C# ----------
    Print("Hello world!");
# ---------- end a_01_helloworld ----------
a_02_formatstring = A_02_FormatString(x=number_slider, y=number_slider)  # -> out, A; inputs x: Double, y: Double
# ---------- a_02_formatstring: C# ----------
    Print("x: {0}; y: {1:.00}", x, y);   //{1:.000} means that a number will be always displayed with 3 decimal places
    //(could be {1:0.00} for two places aswell). Useful eg. for pretty area display.
# ---------- end a_02_formatstring ----------
a_03_cultureinfoformat = A_03_CultureInfoFormat(x=number_slider_2, y=number_slider_2)  # -> out, A; inputs x: Double, y: Double
# ---------- a_03_cultureinfoformat: C# ----------
    System.Globalization.CultureInfo uk = System.Globalization.CultureInfo.GetCultureInfo("en-GB");
    string formatted = string.Format(uk, "x: {0:P2}; y: {1:C2}", x, y);
    //P means percent and C means currency.
    // Following number stands for number of decimal places you want to show
    Print(formatted);
# ---------- end a_03_cultureinfoformat ----------
a_05_comments = A_05_Comments()  # -> out, A
# ---------- a_05_comments: C# ----------
    // a single line comment

    /*
    a multi
    line
    comment
    */

    /* Everything written as a commentary is ommited */

    // Comments should be used when needed and not too obvious
    int i = 0; //declaring variable i   ->  why write that? It's obvious
# ---------- end a_05_comments ----------
o_01_exceptionsandruntimemessages = O_01_ExceptionsAndRuntimeMessages(x=Slider(0, range=0..1))  # -> out, A; inputs x: Double, y: Double
# ---------- o_01_exceptionsandruntimemessages: C# ----------
    Component.Message = "Runtime messages";
    if(x != 0)
      Component.AddRuntimeMessage(GH_RuntimeMessageLevel.Remark, "This is a remark.");
    //Component.AddRuntimeMessage(GH_RuntimeMessageLevel.Warning, "This is a warning.");
    //Component.AddRuntimeMessage(GH_RuntimeMessageLevel.Error, "This is an error!");
    if(x == 0)
      throw new Exception("This is an WS exception");  //prevents from giving any result
      //although you shouldn't throw generic "Exception". Look for more precise reasons

    A = x * y;
# ---------- end o_01_exceptionsandruntimemessages ----------
panel = Panel(a_01_helloworld.out)
panel_2 = Panel(a_03_cultureinfoformat.out)
panel_3 = Panel(a_02_formatstring.out)
panel_4 = Panel(a_04_formatlistandoutput.formattedText)
panel_5 = Panel(a_05_comments.out)
panel_6 = Panel(o_01_exceptionsandruntimemessages.out)
panel_7 = Panel(o_01_exceptionsandruntimemessages.A)
