# Grasshopper definition Creative_Coding_Wickerson_Studios_006.gh (Grasshopper 1.0.7)
# plug-ins: Bifocals

quad_sphere = QuadSphere(Base=PlaneXY(0, 0, 0), Radius=Slider(12, range=0..100))
number_slider = Slider(12, range=0..100)
deconstruct_brep = DeconstructBrep(Brep=quad_sphere)  # -> Faces, Edges, Vertices
divide_domain² = DivideDomain²(Domain=deconstruct_brep.Faces, UCount=number_slider, VCount=number_slider)
isotrim = Isotrim(Surface=graft(deconstruct_brep.Faces), Domain=divide_domain²)
param_viewer = ParamViewer(isotrim)
split_tree = SplitTree(Data=isotrim, Masks=flatten("{*;*;(0,2,...)}[(0,3,...)]"))  # -> Positive, Negative
geometry = Geometry(split_tree.Positive)
geometry_2 = Geometry(split_tree.Negative)
