# Grasshopper definition Creative_Coding_Wickerson_Studios_006b.gh (Grasshopper 1.0.7)
# plug-ins: Bifocals

quad_sphere = QuadSphere(Base=PlaneXY(0, 0, 0), Radius=Slider(11, range=0..100))
number_slider = Slider(20, range=0..100)
deconstruct_brep = DeconstructBrep(Brep=quad_sphere)  # -> Faces, Edges, Vertices
divide_domain² = DivideDomain²(Domain=deconstruct_brep.Faces, UCount=number_slider, VCount=number_slider)
isotrim = Isotrim(Surface=graft(deconstruct_brep.Faces), Domain=divide_domain²)
param_viewer = ParamViewer(isotrim)
split_tree = SplitTree(Data=isotrim, Masks=flatten("{*;*;(0,2,...)}[(0,3,...)]"))  # -> Positive, Negative
geometry = Geometry(split_tree.Positive)
geometry_2 = Geometry(split_tree.Negative)
md_slider = MDSlider(SliderMode=0, slider_value=Point(0.5, 0.5, 0.5), x_domain=Domain(0, 1), y_domain=Domain(0, 1), z_domain=Domain(0, 1))
clean_tree = CleanTree(RemoveNulls=True, RemoveInvalid=True, RemoveEmpty="1", Tree=geometry)
evaluate_surface = EvaluateSurface(Surface=clean_tree, Point=md_slider)  # -> Point, Normal, UDirection, VDirection, Frame
deconstruct_brep_2 = DeconstructBrep(Brep=clean_tree)  # -> Faces, Edges, Vertices
amplitude = Amplitude(Vector=evaluate_surface.Normal, Amplitude=Slider(12, range=0..100))
trim_tree = TrimTree(Tree=deconstruct_brep_2.Edges, Depth=1)  # -> simplify(Tree)
move = Move(Geometry=clean_tree, Motion=amplitude)  # -> Geometry, Transform
deconstruct_brep_3 = DeconstructBrep(Brep=clean_tree)  # -> Faces, Edges, Vertices
param_viewer_2 = ParamViewer(trim_tree)
deconstruct_brep_4 = DeconstructBrep(Brep=move.Geometry)  # -> Faces, Edges, Vertices
trim_tree_2 = TrimTree(Tree=deconstruct_brep_4.Edges, Depth=1)  # -> simplify(Tree)
explode_tree = ExplodeTree(Data=trim_tree)  # -> graft(Branch0), graft(Branch1), graft(Branch2)
explode_tree_2 = ExplodeTree(Data=trim_tree_2)  # -> graft(Branch0), graft(Branch1), graft(Branch2)
param_viewer_3 = ParamViewer(trim_tree_2)
loft = Loft(
    Curves=[explode_tree.Branch2, explode_tree_2.Branch2],
    Options={Adjust=False, Closed=False, LoftEnds=0, LoftSimp=0, LoftType=0, Rebuild=10, Refit=0.01})
loft_2 = Loft(
    Curves=[explode_tree.Branch0, explode_tree_2.Branch0],
    Options={Adjust=False, Closed=False, LoftEnds=0, LoftSimp=0, LoftType=0, Rebuild=10, Refit=0.01})
loft_3 = Loft(
    Curves=[explode_tree.Branch1, explode_tree_2.Branch1],
    Options={Adjust=False, Closed=False, LoftEnds=0, LoftSimp=0, LoftType=0, Rebuild=10, Refit=0.01})
merge = Merge(Data1=deconstruct_brep_3.Faces, Data2=loft_2, Data3=loft_3, Data4=loft, Data5=deconstruct_brep_4.Faces)
