# Grasshopper definition Creative_Coding_Wickerson_Studios_006c.gh (Grasshopper 1.0.7)
# plug-ins: Bifocals

quad_sphere = QuadSphere(Base=PlaneXY(0, 0, 0), Radius=Slider(11, range=0..100))
number_slider = Slider(8, range=0..10)
deconstruct_brep = DeconstructBrep(Brep=quad_sphere)  # -> Faces, Edges, Vertices
divide_domain² = DivideDomain²(Domain=deconstruct_brep.Faces, UCount=number_slider, VCount=number_slider)
isotrim = Isotrim(Surface=graft(deconstruct_brep.Faces), Domain=divide_domain²)
param_viewer = ParamViewer(isotrim)
split_tree = SplitTree(Data=isotrim, Masks=flatten("{*;*;(0,2,4,5)}[(0,3,...)]"))  # -> Positive, Negative
geometry = Geometry(split_tree.Positive)
geometry_2 = Geometry(split_tree.Negative)
md_slider = MDSlider(SliderMode=0, slider_value=Point(0.5, 0.5, 0.5), x_domain=Domain(0, 1), y_domain=Domain(0, 1), z_domain=Domain(0, 1))
clean_tree = CleanTree(RemoveNulls=True, RemoveInvalid=True, RemoveEmpty="1", Tree=geometry)
evaluate_surface = EvaluateSurface(Surface=clean_tree, Point=md_slider)  # -> Point, Normal, UDirection, VDirection, Frame
amplitude = Amplitude(Vector=evaluate_surface.Normal, Amplitude=Slider(7, range=0..10))
move = Move(Geometry=clean_tree, Motion=amplitude)  # -> Geometry, Transform
deconstruct_brep_2 = DeconstructBrep(Brep=clean_tree)  # -> Faces, Edges, Vertices
deconstruct_brep_3 = DeconstructBrep(Brep=move.Geometry)  # -> Faces, Edges, Vertices
deconstruct_brep_4 = DeconstructBrep(Brep=clean_tree)  # -> Faces, Edges, Vertices
point = Point(deconstruct_brep_3.Vertices)
deconstruct = Deconstruct(Point=point)  # -> XComponent, YComponent, ZComponent
trim_tree = TrimTree(Tree=deconstruct_brep_2.Edges, Depth=1)  # -> simplify(Tree)
trim_tree_2 = TrimTree(Tree=deconstruct_brep_3.Edges, Depth=1)  # -> simplify(Tree)
construct_domain = ConstructDomain(DomainStart=0, DomainEnd=1)
bounds = Bounds(Numbers=deconstruct.YComponent)
explode_tree = ExplodeTree(Data=trim_tree_2)  # -> graft(Branch0), graft(Branch1), graft(Branch2), graft(Branch3)
explode_tree_2 = ExplodeTree(Data=trim_tree)  # -> graft(Branch0), graft(Branch1), graft(Branch2), graft(Branch3)
remap_numbers = RemapNumbers(Value=deconstruct.YComponent, Source=bounds, Target=construct_domain)  # -> Mapped, Clipped
loft = Loft(
    Curves=[explode_tree_2.Branch0, explode_tree.Branch0],
    Options={Adjust=False, Closed=False, LoftEnds=0, LoftSimp=0, LoftType=0, Rebuild=10, Refit=0.01})
loft_2 = Loft(
    Curves=[explode_tree_2.Branch1, explode_tree.Branch1],
    Options={Adjust=False, Closed=False, LoftEnds=0, LoftSimp=0, LoftType=0, Rebuild=10, Refit=0.01})
loft_3 = Loft(
    Curves=[explode_tree_2.Branch2, explode_tree.Branch2],
    Options={Adjust=False, Closed=False, LoftEnds=0, LoftSimp=0, LoftType=0, Rebuild=10, Refit=0.01})
loft_4 = Loft(
    Curves=[explode_tree.Branch3, explode_tree_2.Branch3],
    Options={Adjust=False, Closed=False, LoftEnds=0, LoftSimp=0, LoftType=0, Rebuild=10, Refit=0.01})
gradient = Gradient(
    LowerLimit=0,
    UpperLimit=1,
    Parameter=remap_numbers.Mapped,
    stops=[0: RGB(243, 57, 0), 0.1: RGB(236, 27, 60), 0.2: RGB(210, 0, 118), 0.3: RGB(103, 0, 120), 0.5: RGB(1, 192, 229), 0.7: RGB(79, 186, 8), 0.8: RGB(220, 237, 32), 0.845: RGB(18, 178, 90), 0.9: RGB(247, 159, 20), 1: RGB(243, 57, 0)])
merge = Merge(Data1=deconstruct_brep_4.Faces, Data2=loft, Data3=loft_2, Data4=loft_3, Data5=deconstruct_brep_3.Faces, Data6=loft_4)
custom_preview = CustomPreview(Geometry=merge, Material=gradient)
