# Grasshopper definition Creative_Coding_Wickerson_Studios_007.gh (Grasshopper 1.0.7)

rectangular = Rectangular(Plane=PlaneXY(0, 0, 0), SizeX=1, SizeY=2, ExtentX=10, ExtentY=5)  # -> Cells, Points
square = Square(Plane=PlaneXY(0, 0, 0), Size=1, ExtentX=5, ExtentY=5)  # -> Cells, Points
point = Point(simplify(graft(square.Points)))
# THIS IS A TEST SESSION ONLY
# 
# I WILL BE WORKING ON
# AND OFF THIS
# EVENING TO TROUBLE SHOOT
# SOUND AND VIDEO
# 
# mICHAEL wICKERSON
# Fridays
# CET  12:30 pm
# CST  05:30 am
param_viewer = ParamViewer(square.Cells)
panel = Panel("""{1;1}
{-1;1}""")
tree_statistics = TreeStatistics(Tree=point)  # -> simplify(graft(Paths)), Length, Count
text_tag_3d = TextTag3D(Location=square.Points, Text=tree_statistics.Paths, Size=Slider(0.13, range=0..1), Justification=7)
relative_item = RelativeItem(Tree=point, Offset=panel, WrapPaths=False, WrapItems=False)  # -> ItemA, ItemB
line = Line(StartPoint=relative_item.ItemA, EndPoint=relative_item.ItemB)
