# Grasshopper definition Creative_Coding_Wickerson_Studios_008.gh (Grasshopper 1.0.7)
# plug-ins: Bifocals

# ----
# # slider
number_slider = Slider(1, range=0..1)

# ----
# # slider
number_slider_2 = Slider(0.408, range=0..1)

# ----
# component
circle = Circle(Plane=PlaneXY(0, 0, 0), Radius=[number_slider_2, Slider(0.666, range=0..1), Slider(1, range=0..1)])

param_viewer = ParamViewer(circle)

# ----
# panel
panel = Panel(circle)

flatten_tree = FlattenTree(Tree=circle, Path="{0}")  # -> graft(Tree)
unit_z = UnitZ(Factor=Slider(0.83, range=0..10))
dispatch = Dispatch(List=flatten_tree, DispatchPattern=[True, False])  # -> ListA, ListB
explode_tree = ExplodeTree(Data=flatten_tree)  # -> Branch0, Branch1, Branch2
param_viewer_2 = ParamViewer(dispatch.ListB)
param_viewer_3 = ParamViewer(dispatch.ListA)
merge = Merge(Data1=dispatch.ListA, Data2=dispatch.ListB)
param_viewer_4 = ParamViewer(explode_tree.Branch1)
param_viewer_5 = ParamViewer(explode_tree.Branch2)
param_viewer_6 = ParamViewer(explode_tree.Branch0)
trim_tree = TrimTree(Depth=1)
move = Move(Geometry=explode_tree.Branch1, Motion=unit_z)  # -> Geometry, Transform
loft = Loft(Curves=merge, Options={Adjust=False, Closed=False, LoftEnds=0, LoftSimp=0, LoftType=0, Rebuild=10, Refit=0.01})
merge_2 = Merge(Data1=explode_tree.Branch0, Data2=move.Geometry, Data3=explode_tree.Branch2)  # -> flatten(Result)
loft_2 = Loft(Curves=merge_2, Options={Adjust=False, Closed=False, LoftEnds=0, LoftSimp=0, LoftType=0, Rebuild=10, Refit=0.01})

# ----
# component
circle_2 = Circle(Plane=PlaneXY(0, 0, 0), Radius=[number_slider, Slider(0.842, range=0..1)])

param_viewer_7 = ParamViewer(circle_2)
flatten_tree_2 = FlattenTree(Tree=circle_2, Path="{0}")
dispatch_2 = Dispatch(List=flatten_tree_2, DispatchPattern=[True, False])  # -> ListA, ListB
param_viewer_8 = ParamViewer(dispatch_2.ListA)
merge_3 = Merge(Data1=dispatch_2.ListA, Data2=dispatch_2.ListB)
param_viewer_9 = ParamViewer(dispatch_2.ListB)
loft_3 = Loft(Curves=merge_3, Options={Adjust=False, Closed=False, LoftEnds=0, LoftSimp=0, LoftType=0, Rebuild=10, Refit=0.01})

# ----
# panel
panel_2 = Panel(circle_2)
